# Grasshopper definition TensegritySimplexAnalysis.gh (Grasshopper 1.0.7)
# plug-ins: Muscle

display = DisplaySettings(
    SupportsSize=Slider(0.1, range=0.01..2),
    LoadsSize=Slider(2.49, range=0.01..20),
    Decimal="2",
    GMS²=Vector(0, 0, -9.81),
    DynamicMassScale=1)
startpy = StartPythonNET(
    StartPython=Toggle(True),
    AnacondaDirectory="C:\Users\Jonas\Anaconda3",
    CondaEnvironmentName="base",
    Python3xxDllFile="python312.dll")

# ---- group: Dimension of reference
diameter_of_base_outer_circle_m = Slider(2.36, range=0.5..20)

# ---- group: Height profile along the curve
assembly_profile = GraphMapper(x0=0, x1=1, y0=0, y1=1, A=0, B=1, container_name="Linear", Graph_x0=0, Graph_x1=1, Graph_y0=1, Graph_y1=1)

# ---- group: Number of edges per module
reference_polygon = Slider(3, range=3..10)

# ---- group: Number of additional long cables per module
# Description: Structure can't have more add cables than edges
additional_long_cables = Slider(0, range=0..10)
min = Minimum(A=reference_polygon, B=additional_long_cables)

# ----
structure_alignement = Slider(0, range=-180..180)

# ---- group: Span
main_dimension_m = Slider(1.95, range=0.1..100)

# ---- group: Span / max excentricity f
main_dimension_m_2 = Slider(0, range=0..100)

# ---- group: Relative rotation between bases
# Alterned rotation
relative_rotation = Slider(30, range=0..180)
relative_rotation_2 = ValueList({"Alterned": 0, "Spiral": 1}, selected="Alterned")

# ----
# INPUTS
pt = ConstructPoint(XCoordinate="0.59", YCoordinate="-1.02191", ZCoordinate="0")
number_of_modules = Slider(1, range=1..20)
cells_position_on_graph = Range(Domain=Domain(0, 1), Steps=number_of_modules)

# ---- group: Curve shape
assembly_profile_2 = GraphMapper(flatten(cells_position_on_graph), x0=0, x1=1, y0=0, y1=1, Ox=0.4982714355, Oy=1, Px=1, Py=0, container_name="Parabola")

# ---- group: Draw additional transversal cables ?
add_transv_cables = BooleanToggle(False)

# ----
# Height profile
height_factor = Panel(assembly_profile)

# ---- group: Start point
pt_2 = Point(pt)

# ----
# DRAW GEOMETRY
multiplication = Multiplication(A=diameter_of_base_outer_circle_m, B=height_factor)
diameter_of_each_outer_circle = Panel(multiplication)

# ---- group: Create curve
cluster = Cluster_5(P=pt_2, B_2=main_dimension_m, N=number_of_modules, A=main_dimension_m_2, B=assembly_profile_2)

# ---- group: Create curve / curve
crv = Curve(cluster)

# ---- group: Create base planes / Structure Alignment (°)
rad = Radians(Degrees=structure_alignement)

# ---- group: Create base planes / curve
reference_curve = Curve(crv)

# ---- group: Create base planes / nbr modules
number_of_cells = Integer(number_of_modules)

# ---- group: Create base planes
create_structure = CreateStructure(C=reference_curve, N=number_of_cells, A=rad)

# ---- group: Create base planes / base planes
construction_planes = Plane(create_structure)

# ---- group: Rotate base planes / Rotation (°)
rad_2 = Radians(Degrees=relative_rotation)

# ---- group: Rotate base planes / 0 Alterned / 1 Spiral
rotation_type = Integer(relative_rotation_2)

# ---- group: Rotate base planes / base planes
pln = Plane(construction_planes)

# ---- group: Rotate base planes
rotate_base_planes = RotateBasePlanes(relay=pln, angle_rad=rad_2, _0_alterned_1_spiral=rotation_type)

# ---- group: Rotate base planes / Rotated base planes
construction_planes_2 = Plane(rotate_base_planes)

# ---- group: Create base cables and nodes / Base planes
pln_2 = Plane(construction_planes_2)

# ---- group: Create base cables and nodes / Diameters of outer circles
num = Number(diameter_of_each_outer_circle)

# ---- group: Create base cables and nodes / Nbr of edges
int = Integer(reference_polygon)

# ---- group: Create base cables and nodes
polygon = Polygon(Plane=pln_2, Radius=expr("x/2", num), Segments=int, FilletRadius=0)  # -> simplify(Polygon), Length
cluster_2 = Cluster(C=polygon.Polygon)  # -> S, S_2

# ---- group: Create base cables and nodes / Nodes
pt_3 = Point(cluster_2.S_2)

# ---- group: Create base cables and nodes / Base cables
line = Line(cluster_2.S)

# ---- group: Create Struts / Nodes
pt_4 = Point(pt_3)

# ---- group: Create Struts / 0 Alterned / 1 Spiral
rotation_type_2 = Integer(relative_rotation_2)

# ---- group: Create add long. cables / 0 Alterned / 1 Spiral
rotation_type_3 = Integer(relative_rotation_2)

# ---- group: Create add long. cables / nbr of add long cables
int_2 = Integer(min)

# ---- group: Create add transv. cables / add transverse cables ?
bool = Boolean(add_transv_cables)

# ---- group: Create add transv. cables / Bases planes
construction_planes_3 = Plane(construction_planes)

# ---- group: Create long Cables / Nodes
pt_5 = Point(pt_3)

# ---- group: Create add long. cables / Nodes
pt_6 = Point(pt_3)

# ---- group: Create add transv. cables / Nodes
pt_7 = Point(pt_3)

# ---- group: Create Struts
cluster_3 = Cluster_4(nodes=pt_4, alterned_spiral=rotation_type_2)

# ---- group: Create add long. cables
cluster_4 = Cluster_3(nodes=pt_6, alterned_spiral=rotation_type_3, nbr_add_cables=int_2)

# ---- group: Create add transv. cables
cluster_5 = Cluster_2(bool=bool, nodes=pt_7, planes=construction_planes_3)  # -> cables, points

# ---- group: Create long Cables
long_cables = LongCables(T=pt_5)

# ---- group: Create add long. cables / Add Long Cables
line_2 = Line(simplify(cluster_4))

# ---- group: Create add transv. cables / Add transv. Cables
line_3 = Line(simplify(cluster_5.cables))

# ---- group: Create long Cables / Long cables
line_4 = Line(long_cables)

# ---- group: Create Struts / Struts
line_5 = Line(cluster_3)

# ---- group: Create add transv. cables / Add center points
pt_8 = Point(cluster_5.points)

# ---- group: Base cables
line_6 = Line(line)

# ---- group: Long Cables
line_7 = Line(line_4)

# ---- group: Struts
line_8 = Line(line_5)

# ---- group: Nodes
pt_9 = Point(pt_3)

# ---- group: Add long Cables
line_9 = Line(line_2)

# ---- group: Draw elements length
line_10 = Line(flatten([line_4, line_5, line_2, line]))
# DISPLAY GEOMETRY INFO
translation_z = Slider(-0.02, range=-1..1.1)
len = Length(Curve=line_10)
eval = EvaluateCurve(Curve=line_10, Parameter="0.5")  # -> Point, Tangent, Angle
multiplication_2 = Multiplication(A=len, B=1000)
Z = UnitZ(Factor=translation_z)
expression = Expression(x=multiplication_2, Expression="Format(\"{0:0.0}\", x)")
addition = Addition(A=Z, B=eval.Point)
tag = TextTag(Location=addition, Text=expression, Colour=ColourSwatch(SwatchColor=RGB(153, 0, 0)))

# ----
panel = Panel("""3
4
5""")
panel_2 = Panel("""0
1
2""")
height = GenePool(Decimals=2, Maximum=0, Minimum=-1, Value=[-0.24, -0.24, -0.34])

# ---- group: struts
# GENERATE FINITE ELEMENT MODEL
number_slider = Slider(60, range=0.1..100)
dom = ConstructDomain(DomainStart=expr("-x", "160"), DomainEnd="160")
M = MaterialLinear(Name="struts", YoungModulus="70390", YieldStrengths=dom, SpecificMass="0")
circular = CrossSectionCircular(Diameter=number_slider, Thickness="2")
line_11 = Line(line_8)
E = Element(Line=line_11, CrossSection=circular, Material=M, ElementName="struts", BucklingLaw=-1, BucklingFactor="1.055")
pipe = Pipe(Curve=line_11, Radius=expr("x/2000", number_slider), Caps=0)

# ---- group: long cables
number_slider_2 = Slider(8, range=0.1..10)
dom_2 = ConstructDomain(DomainStart="-120", DomainEnd="120")
M_2 = MaterialBilinear(Name="long cables", CompressiveYoungModulus="0", TensileYoungModulus="72190", YieldStrengths=dom_2, SpecificMass="0")
circular_2 = CrossSectionCircular(Diameter=number_slider_2, Thickness=0)
line_12 = Line(line_7)
E_2 = Element(Line=line_12, CrossSection=circular_2, Material=M_2, ElementName="long cables", BucklingLaw=10, BucklingFactor=1)
pipe_2 = Pipe(Curve=line_12, Radius=expr("x/2000", number_slider_2), Caps=0)

# ---- group: Base cables
number_slider_3 = Slider(8, range=0.1..10)
dom_3 = ConstructDomain(DomainStart="-120", DomainEnd="120")
M_3 = MaterialBilinear(Name="base cables", CompressiveYoungModulus="0", TensileYoungModulus="71750", YieldStrengths=dom_3, SpecificMass="0")
circular_3 = CrossSectionCircular(Diameter=number_slider_3, Thickness=0)
line_13 = Line(line_6)
E_3 = Element(Line=line_13, CrossSection=circular_3, Material=M_3, ElementName="base cables", BucklingLaw=10, BucklingFactor=1)
pipe_3 = Pipe(Curve=line_13, Radius=expr("x/2000", number_slider_3), Caps=0)

# ---- group: All Nodes
pt_10 = Point(pt_9)

# ---- group: Set nodes index
cluster_6 = Cluster_6(pt=pt_10)

# ---- group: Nodes (correctly ordered)
pt_11 = Point(cluster_6)

# ---- group: Display Angles / All Nodes
pt_12 = Point(pt_11)

# ---- group: All Nodes
pt_13 = Point(pt_12)

# ---- group: Draw nodes coordinates (mm) / All Nodes
pt_14 = Point(pt_11)

# ---- group: Draw nodes coordinates (mm)
translation_z_2 = Slider(0.05, range=-1..1.1)
multiplication_3 = Multiplication(A=pt_14, B=1000)
Z_2 = UnitZ(Factor=translation_z_2)
eval_2 = Evaluate(F="Format(\"({0:0.0}, {1:0.0}, {2:0.0})\", x.x, x.y, x.z)", x=multiplication_3)
addition_2 = Addition(A=Z_2, B=pt_14)
tag_2 = TextTag(Location=addition_2, Text=eval_2, Colour=ColourSwatch(SwatchColor=RGB(25, 0, 153)))

# ----
item = ListItem(List=pt_13, Index=panel, Wrap=True)
item_2 = ListItem(List=pt_13, Index=panel_2, Wrap=True)

# ---- group: Bottom Nodes
pt_15 = Point(flatten(item_2))

# ---- group: Top Nodes
pt_16 = Point(item)

# ----
bang = ExplodeTree(Data=graft(pt_16))  # -> Branch0, Branch1, Branch2
pl_3pt = Plane3Pt(PointA=bang.Branch1, PointB=bang.Branch0, PointC=bang.Branch2)
avr = Average(Input=pt_16)
pln_3 = Plane(pl_3pt)

# ---- group: Define supports / Nodes
pt_17 = Point(pt_11)

# ---- group: Node preview
offset_z = Slider(0.15, range=0.01..1)
cluster_7 = Cluster_12(pt=pt_11, R=Slider(0.035, range=0.01..0.15), F=offset_z)  # -> S, swatch, r, R_2
nodes_coord_m = Panel(cluster_7.r)
points = PointList(Points=flatten(cluster_7.R_2), Size="0.12")
preview = CustomPreview(Geometry=flatten(cluster_7.S), Material=cluster_7.swatch)

# ---- group: Define supports
item_3 = ListItem(List=pt_17, Index="1", Wrap=True)
item_4 = ListItem(List=pt_17, Index="2", Wrap=True)
item_5 = ListItem(List=pt_17, Index="0", Wrap=True)

# ---- group: Define supports / Block X
sptx = SupportX(Point=[item_3, item_5])

# ---- group: Define supports / Block Y
spty = SupportY(Point=item_3)

# ---- group: Define supports / Block Z
sptz = SupportZ(Point=[item_3, item_5, item_4])

# ---- group: Elements preview
preview_2 = CustomPreview(Geometry=flatten([pipe_3, pipe_2]), Material=ColourSwatch(SwatchColor=RGB(41, 41, 204)))
preview_3 = CustomPreview(Geometry=flatten(pipe), Material=ColourSwatch(SwatchColor=RGB(178, 178, 178)))

# ---- group: All elements
entwine = Entwine(Branch00=E, Branch01=E_3, Branch02=E_2, FlattenInputs=True)  # -> flatten(Result)

# ---- group: Display elements name
E_4 = Element(entwine)
line_14 = Line(flatten(E_4))
translation_z_3 = Slider(0, range=-1..1.1)
eval_3 = EvaluateCurve(Curve=line_14, Parameter="0.5")  # -> Point, Tangent, Angle
panel_3 = Panel("""S1
S2
S3
CB1
CB2
CB3
CT1
CT2
CT3
CV1
CV2
CV3""")
Z_3 = UnitZ(Factor=translation_z_3)
addition_3 = Addition(A=Z_3, B=eval_3.Point)
tag_3 = TextTag(Location=addition_3, Text=panel_3, Colour=ColourSwatch(SwatchColor=RGB(76, 0, 0)))

# ---- group: Nodes
pt_18 = Point(pt_11)

# ---- group: Define supports / Supports
spt = Support([spty, sptx, sptz])

# ---- group: Finite Element Model
structure = ConstructStructure(Elements=entwine, Points=pt_18, Supports=spt)

# ----
# SELF-STRESS and MECHANISMS ANALYSIS
svd = SolverSelfstressAndMechanismsAnalysisBySingularValueDecomposition(Structure=structure, RelativeTolerance=0.001)  # -> struct, r, S, s, Vs_T, Vr_T, m, Um_T, Ur_T
mode_index = Slider(0, range=0..10)
mode_index_2 = Slider(0, range=0..10)
vec = Vector(svd.Um_T)

# ---- group: Select mode
select_mode = SelectMode(T=vec, I=mode_index)

select_mode_2 = SelectMode(T=svd.Vs_T, I=mode_index_2)

# ---- group: retrieve lines
cluster_8 = Cluster_13(struct=svd.struct)

# ---- group: Mechanism
vec_2 = Vector(select_mode)

# ---- group: Self-stress mode
num_2 = Number(select_mode_2)

# ---- group: Rescale mechanism
cluster_9 = Cluster_15(vec=vec_2)

# ---- group: Rescale self-stress mode
cluster_10 = Cluster_14(num=num_2)

# ---- group: Preview self-stress mode
showf = ShowForces(
    Lines=cluster_8,
    Forces=cluster_10,
    TensionThickness="3",
    CompressionThickness=expr("x*2", "3"),
    ValueSettings="1",
    TextSize=0.1)

# ----
# APPLY SELF-WEIGHT and INITIAL PRESTRESS
sw = SelfWeight()

# ----
# STRUCTURE PROPERTIES
disassemble = StructureDisassemble()  # -> Nodes, Elements; disabled
len_2 = Length()  # disabled
cs_prop = CrossSectionProperties()  # -> Dimension, Thickness, DimensionThickness, AMm2, Inertia, QIA2; disabled

# ---- group: A (mm²)
num_3 = Number(flatten(cs_prop.AMm2))  # disabled

# ---- group: E (N/mm²)
num_4 = Number()  # disabled

# ---- group: L (m)
num_5 = Number(flatten(len_2))  # disabled

# ----
# APPLY SELF-WEIGHT
structure_2 = Relay()  # disabled
deformed_structure = Relay()  # disabled

# ---- group: Self-Weight loads
panel_4 = Panel("""45.7
45.7
45.7
41.6
41.6
41.6""")  # disabled
disassemble_2 = StructureDisassemble(Structure=structure_2)  # -> Nodes, Elements; disabled
division = Division(A=panel_4, B=1000)  # disabled
neg = Negative(Value=division)  # disabled
Z_4 = UnitZ(Factor=neg)  # disabled
load = PointLoad(Vector=Z_4)  # disabled

# ---- group: Draw elements length
line_15 = Line()  # disabled
# DISPLAY GEOMETRY INFO
translation_z_4 = Slider(-0.02, range=-1..1.1)  # disabled
len_3 = Length(Curve=line_15)  # disabled
panel_5 = Panel("0.5")  # disabled
eval_4 = EvaluateCurve(Curve=line_15, Parameter=panel_5)  # -> Point, Tangent, Angle; disabled
multiplication_4 = Multiplication(A=len_3, B=1000)  # disabled
Z_5 = UnitZ(Factor=translation_z_4)  # disabled
expression_2 = Expression(x=multiplication_4, Expression="Format(\"{0:0.0}\", x)")  # disabled
addition_4 = Addition(A=Z_5, B=eval_4.Point)  # disabled
swatch = ColourSwatch(SwatchColor=RGB(153, 0, 0))  # disabled
tag_4 = TextTag(Location=addition_4, Text=expression_2, Colour=swatch)  # disabled

# ---- group: Displacements and Forces Results
disassemble_3 = StructureDisassemble(Structure=deformed_structure)  # -> Nodes, Elements; disabled
vec2pt = Vector2Pt(Unitize=False)  # -> Vector, Length; disabled
eval_5 = Evaluate(F="Format(\"{0:0.00} {1:0.00} {2:0.00}\", x.x*1000, x.y*1000, x.z*1000)")  # disabled
devec = DeconstructVector()  # -> XComponent, YComponent, ZComponent; disabled
showf_2 = ShowForces(Thickness=2, ValueSettings=2, TextSize_2=0.1)  # disabled
eval_6 = Evaluate(F="Format(\"{0:0.0000}\",x)")  # disabled
number_slider_4 = Slider(0.13, range=0.01..1)  # disabled
expression_3 = Expression(x=devec.ZComponent, Expression="Format(\"{0:0.000}\", x)")  # disabled
coord_in_mm = Panel(eval_5)  # disabled
swatch_2 = ColourSwatch(SwatchColor=RGB(0, 255, 21))  # disabled
forces_in_kn = Panel(eval_6)  # disabled
sph = Sphere(Base=PlaneXY(0, 0, 0), Radius=expr("-x*1.5", devec.ZComponent))  # disabled
panel_6 = Panel("3")  # disabled
vdisex = VectorDisplayEx(Vector=expr("x*10", vec2pt.Vector), Colour=RGB(0, 0, 0), Width=panel_6)  # disabled
preview_4 = CustomPreview(Geometry=flatten(sph), Material=swatch_2)  # disabled
swatch_3 = ColourSwatch(SwatchColor=RGB(0, 178, 15))  # disabled
cluster_11 = Cluster_9(F=number_slider_4)  # disabled
tag_5 = TextTag(Location=cluster_11, Text=expression_3, Colour=swatch_3)  # disabled

# ---- group: Display Angles / All Nodes
pt_19 = Point()  # disabled

# ---- group: Display Angles
height_2 = GenePool(Decimals=2, Maximum=0, Minimum=-1, Value=[-0.24, -0.24, -0.69])  # disabled
cluster_12 = Cluster_7(pt=pt_19)  # -> am, bottom_nodes, G; disabled
amplify_factor = Slider(1.44, range=0.75..2)  # disabled
cluster_13 = Cluster_8(L=pt_19)  # disabled
panel_7 = Panel("0")  # disabled
item_6 = ListItem(List=cluster_13, Index=panel_7, Wrap=True)  # disabled
item_7 = ListItem(List=cluster_12.G, Index=panel_7, Wrap=True)  # disabled
item_8 = ListItem(List=cluster_12.bottom_nodes, Index=panel_7, Wrap=True)  # disabled
item_9 = ListItem(List=height_2, Index=panel_7, Wrap=True)  # disabled
subtraction = Subtraction(A=item_6, B=item_8)  # disabled
pt_20 = Point(cluster_12.am)  # disabled
Z_6 = UnitZ(Factor=item_9)  # disabled
eval_7 = Evaluate(F="Format(\"{0:0.0}\", x.z*1000)", x=subtraction)  # disabled
Z_7 = UnitZ(Factor=1)  # disabled
cluster_14 = Cluster_11(A_2=pt_20, A=pt_20, B=item_7, B_2=amplify_factor)  # disabled
cluster_15 = Cluster_11(A_2=pt_20, A=pt_20, B=item_8, B_2=amplify_factor)  # disabled
vec2pt_2 = Vector2Pt(PointA=item_6, PointB=item_7, Unitize=False)  # -> Vector, Length; disabled
addition_5 = Addition(A=item_6, B=Z_6)  # disabled
pl = ConstructPlane(Origin=addition_5, XAxis=Z_7, YAxis=Vector(0, 1, 0))  # disabled
panel_8 = Panel("0.10")  # disabled
vdis = VectorDisplay(Anchor=item_7, Vector=expr("-x", vec2pt_2.Vector))  # disabled
cluster_16 = Cluster_10(num=panel_8, L_5=pl, L_6=eval_7, L_3=pl, L_4=eval_7, L=pl, L_2=eval_7)  # disabled
vdis_2 = VectorDisplay(Anchor=item_6, Vector=vec2pt_2.Vector)  # disabled
angledim = AngularDimension(Center=pt_20, PointA=cluster_15, PointB=cluster_14, Reflex=False, Text="{0:0.0}°", Size=panel_8)  # disabled

# ----
vec2pt_3 = Vector2Pt(PointA=pt_20, PointB=cluster_15, Unitize=False)  # -> Vector, Length; disabled
vec2pt_4 = Vector2Pt(PointA=pt_20, PointB=cluster_14, Unitize=False)  # -> Vector, Length; disabled
angle = Angle(VectorA=vec2pt_3.Vector, VectorB=vec2pt_4.Vector)  # -> Angle, Reflex; disabled
deg = Degrees(Radians=angle.Angle)  # disabled
alpha = Panel(deg)  # disabled

# ----
# APPLY external load
structure_3 = Relay()  # disabled
deformed_structure_2 = Relay()  # disabled

number_slider_5 = Slider(1000, range=0..8000)  # disabled
number_slider_6 = Slider(2084, range=0..2300)  # disabled
division_2 = Division(A=number_slider_5, B=1000)  # disabled
panel_9 = Panel("3")  # disabled
Z_8 = UnitZ(Factor=expr("x*3", division_2))  # disabled
Y = UnitY(Factor=expr("-x", division_2))  # disabled
item_10 = ListItem(Index=panel_9, Wrap=True)  # disabled
X = UnitX(Factor=division_2)  # disabled
neg_2 = Negative(Value=Z_8)  # disabled
panel_10 = Panel("""3
4
5""")  # disabled

# ---- group: Draw elements length
line_16 = Line()  # disabled
# DISPLAY GEOMETRY INFO
translation_z_5 = Slider(-0.02, range=-1..1.1)  # disabled
len_4 = Length(Curve=line_16)  # disabled
panel_11 = Panel("0.5")  # disabled
eval_8 = EvaluateCurve(Curve=line_16, Parameter=panel_11)  # -> Point, Tangent, Angle; disabled
multiplication_5 = Multiplication(A=len_4, B=1000)  # disabled
Z_9 = UnitZ(Factor=translation_z_5)  # disabled
expression_4 = Expression(x=multiplication_5, Expression="Format(\"{0:0.0}\", x)")  # disabled
addition_6 = Addition(A=Z_9, B=eval_8.Point)  # disabled
swatch_4 = ColourSwatch(SwatchColor=RGB(153, 0, 0))  # disabled
tag_6 = TextTag(Location=addition_6, Text=expression_4, Colour=swatch_4)  # disabled

# ---- group: Display Angles / All Nodes
pt_21 = Point()  # disabled

# ----
panel_12 = Panel("3")  # disabled
load_2 = PointLoad(Point=item_10, Vector=neg_2)  # disabled
item_11 = ListItem(Index=panel_10, Wrap=True)  # disabled

# ---- group: Self-Weight loads
number_slider_7 = Slider(21, range=0..21)  # disabled
external_load_n_node = Panel("""0.0
112.3
210.4
308.5
406.6
504.7
602.8
700.9
799.0
897.1
995.2
1093.3
1191.4
1289.5
1389.5
1489.5
1589.5
1689.5
1789.5
1887.6
1985.7
2083.8""")  # disabled
item_12 = ListItem(List=external_load_n_node, Index=number_slider_7, Wrap=False)  # disabled
disassemble_4 = StructureDisassemble(Structure=structure_3)  # -> Nodes, Elements; disabled
division_3 = Division(A=number_slider_6, B=1000)  # disabled
neg_3 = Negative(Value=division_3)  # disabled
Z_10 = UnitZ(Factor=neg_3)  # disabled
load_3 = PointLoad(Point=item_11, Vector=Z_10)  # disabled

# ----
relay = Relay()  # disabled
vdisex_2 = VectorDisplayEx(Point=item_10, Vector=expr("x", neg_2), Colour=swatch_3, Width=panel_12)  # disabled

# ---- group: Display Angles
height_3 = GenePool(Decimals=2, Maximum=0, Minimum=-1, Value=[-0.24, -0.24, -0.34])  # disabled
cluster_17 = Cluster_7(pt=pt_21)  # -> am, bottom_nodes, G; disabled
amplify_factor_2 = Slider(1.44, range=0.75..2)  # disabled
cluster_18 = Cluster_8(L=pt_21)  # disabled
panel_13 = Panel("""0
1
2""")  # disabled
item_13 = ListItem(List=cluster_18, Index=panel_13, Wrap=True)  # disabled
item_14 = ListItem(List=cluster_17.G, Index=panel_13, Wrap=True)  # disabled
item_15 = ListItem(List=cluster_17.bottom_nodes, Index=panel_13, Wrap=True)  # disabled
item_16 = ListItem(List=height_3, Index=panel_13, Wrap=True)  # disabled
subtraction_2 = Subtraction(A=item_13, B=item_15)  # disabled
pt_22 = Point(cluster_17.am)  # disabled
Z_11 = UnitZ(Factor=item_16)  # disabled
eval_9 = Evaluate(F="Format(\"{0:0.0}[mm]\", x.z*1000)", x=subtraction_2)  # disabled
Z_12 = UnitZ(Factor=1)  # disabled
cluster_19 = Cluster_11(A_2=pt_22, A=pt_22, B=item_14, B_2=amplify_factor_2)  # disabled
cluster_20 = Cluster_11(A_2=pt_22, A=pt_22, B=item_15, B_2=amplify_factor_2)  # disabled
vec2pt_5 = Vector2Pt(PointA=item_13, PointB=item_14, Unitize=False)  # -> Vector, Length; disabled
addition_7 = Addition(A=item_13, B=Z_11)  # disabled
pl_2 = ConstructPlane(Origin=addition_7, XAxis=Z_12, YAxis=Vector(0, 1, 0))  # disabled
panel_14 = Panel("0.10")  # disabled
cluster_21 = Cluster_10(num=panel_14, L_5=pl_2, L_6=eval_9, L_3=pl_2, L_4=eval_9, L=pl_2, L_2=eval_9)  # disabled
vdis_3 = VectorDisplay(Anchor=item_14, Vector=expr("-x", vec2pt_5.Vector))  # disabled
vdis_4 = VectorDisplay(Anchor=item_13, Vector=vec2pt_5.Vector)  # disabled
angledim_2 = AngularDimension(Center=pt_22, PointA=cluster_20, PointB=cluster_19, Reflex=False, Text="{0:0.0}°", Size=panel_14)  # disabled

# ----
subtraction_3 = Subtraction(B=relay)  # disabled
number_slider_8 = Slider(4, range=1..5)  # disabled
devec_2 = DeconstructVector(Vector=subtraction_3)  # -> XComponent, YComponent, ZComponent; disabled
panel_15 = Panel("""3
4
5""")  # disabled
panel_16 = Panel("2")  # disabled
item_17 = ListItem(Index=panel_15, Wrap=True)  # disabled
panel_17 = Panel("""3
4
5""")  # disabled
item_18 = ListItem(List=devec_2.ZComponent, Index=panel_17, Wrap=True)  # disabled
division_4 = Division(A=Z_10, B=number_slider_8)  # disabled
number_slider_9 = Slider(0.06, range=0.01..1)  # disabled
expression_5 = Expression(x=item_18, Expression="Format(\"{0:0.0}\", x)")  # disabled
subtraction_4 = Subtraction(A=item_17, B=division_4)  # disabled

# ---- group: Displacements and Forces Results
disassemble_5 = StructureDisassemble(Structure=deformed_structure_2)  # -> Nodes, Elements; disabled
vec2pt_6 = Vector2Pt(Unitize=False)  # -> Vector, Length; disabled
eval_10 = Evaluate(F="Format(\"{0:0.00} {1:0.00} {2:0.00}\", x.x*1000, x.y*1000, x.z*1000)")  # disabled
devec_3 = DeconstructVector(Vector=relay)  # -> XComponent, YComponent, ZComponent; disabled
showf_3 = ShowForces(Thickness=2, ValueSettings=panel_16, TextSize_2=0.1)  # disabled
eval_11 = Evaluate(F="Format(\"{0:0.0000}\",x)")  # disabled
number_slider_10 = Slider(0.13, range=0.01..1)  # disabled
expression_6 = Expression(x=devec_3.ZComponent, Expression="Format(\"{0:0.000}\", x)")  # disabled
coord_in_mm_2 = Panel(eval_10)  # disabled
swatch_5 = ColourSwatch(SwatchColor=RGB(0, 255, 21))  # disabled
forces_in_kn_2 = Panel(eval_11)  # disabled
sph_2 = Sphere(Base=PlaneXY(0, 0, 0), Radius=expr("-x*1.5", devec_3.ZComponent))  # disabled
panel_18 = Panel("3")  # disabled
preview_5 = CustomPreview(Geometry=flatten(sph_2), Material=swatch_5)  # disabled
swatch_6 = ColourSwatch(SwatchColor=RGB(0, 178, 15))  # disabled
cluster_22 = Cluster_9(F=number_slider_10)  # disabled
vdisex_3 = VectorDisplayEx(Point=subtraction_4, Vector=division_4, Colour=swatch_6, Width=panel_18)  # disabled
tag_7 = TextTag(Location=cluster_22, Text=expression_6, Colour=swatch_6)  # disabled

# ----
panel_19 = Panel("""0
1
2""")  # disabled
swatch_7 = ColourSwatch(SwatchColor=RGB(0, 178, 15))  # disabled
rec = DataRecorder(item_12, DataLimit=-10, RecordData=True)  # disabled
cluster_23 = Cluster_9(F=number_slider_9, B=subtraction_4)  # disabled
devec_4 = DeconstructVector()  # -> XComponent, YComponent, expr("x*1000", ZComponent); disabled
item_19 = ListItem(Index=panel_19, Wrap=True)  # disabled
item_20 = ListItem(Index=panel_19, Wrap=True)  # disabled
tag_8 = TextTag(Location=cluster_23, Text=expression_5, Colour=swatch_7)  # disabled
vec2pt_7 = Vector2Pt(PointA=pt_22, PointB=cluster_20, Unitize=False)  # -> Vector, Length; disabled
vec2pt_8 = Vector2Pt(PointA=pt_22, PointB=cluster_19, Unitize=False)  # -> Vector, Length; disabled
panel_20 = Panel("10")  # disabled
panel_21 = Panel(rec)  # disabled
item_21 = ListItem(List=devec_4.ZComponent, Index=5, Wrap=True)  # disabled
showf_4 = ShowForces(Lines=item_19, Forces=item_20, Thickness=panel_20, ValueSettings=panel_16, TextSize_2=0.1)  # disabled
angle_2 = Angle(VectorA=vec2pt_7.Vector, VectorB=vec2pt_8.Vector)  # -> Angle, Reflex; disabled
rec_2 = DataRecorder(item_21, DataLimit=-10, RecordData=True)  # disabled
panel_22 = Panel(item_21)  # disabled
item_22 = ListItem(List=angle_2.Angle, Index=0, Wrap=True)  # disabled
item_23 = ListItem(Index=0, Wrap=True)  # disabled
item_24 = ListItem(Index=9, Wrap=True)  # disabled
limit = Panel("-10.66")  # disabled
panel_23 = Panel(rec_2)  # disabled
deg_2 = Degrees(Radians=item_22)  # disabled
subtraction_5 = Subtraction(A=limit, B=item_23)  # disabled
panel_24 = Panel(item_23)  # disabled
panel_25 = Panel(item_24)  # disabled
alpha_2 = Panel(deg_2)  # disabled
sqr = Square(Value=subtraction_5)  # disabled
rec_3 = DataRecorder(deg_2, DataLimit=-10, RecordData=True)  # disabled
galapagos = Galapagos(fitness=sqr, gene=number_slider_6)
panel_26 = Panel(rec_3)  # disabled

# ---- group: Display Angles
cluster_24 = Cluster_7(pt=pt_12)  # -> am, bottom_nodes, G
amplify_factor_3 = Slider(1.44, range=0.75..2)
cluster_25 = Cluster_8(L=pt_12)
panel_27 = Panel("2")
item_25 = ListItem(List=cluster_25, Index=panel_27, Wrap=True)
item_26 = ListItem(List=cluster_24.G, Index=panel_27, Wrap=True)
item_27 = ListItem(List=cluster_24.bottom_nodes, Index=panel_27, Wrap=True)
subtraction_6 = Subtraction(A=item_25, B=item_27)
pt_23 = Point(cluster_24.am)
eval_12 = Evaluate(F="Format(\"{0:0.0}[mm]\", x.z*1000)", x=subtraction_6)
Z_13 = UnitZ(Factor=1)
vec2pt_9 = Vector2Pt(PointA=item_25, PointB=item_26, Unitize=False)  # -> Vector, Length
vdis_5 = VectorDisplay(Anchor=item_25, Vector=vec2pt_9.Vector)

# ----
item_28 = ListItem(List=height, Index=panel_27, Wrap=True)
item_29 = ListItem(List=pt_16, Index=panel_27, Wrap=True)
cluster_26 = Cluster_11(A_2=pt_23, A=pt_23, B=item_26, B_2=amplify_factor_3)
cluster_27 = Cluster_11(A_2=pt_23, A=pt_23, B=item_27, B_2=amplify_factor_3)

# ---- group: Display Angles (continued)
Z_14 = UnitZ(Factor=item_28)
addition_8 = Addition(A=item_25, B=Z_14)
pl_3 = ConstructPlane(Origin=addition_8, XAxis=Z_13, YAxis=Vector(0, 1, 0))
cluster_28 = Cluster_10(num="0.10", L_5=pl_3, L_6=eval_12, L_3=pl_3, L_4=eval_12, L=pl_3, L_2=eval_12)
angledim_3 = AngularDimension(Center=pt_23, PointA=cluster_27, PointB=cluster_26, Reflex=False, Text="{0:0}°", Size="0.10")

# ----
vdis_6 = VectorDisplay(Anchor=item_26, Vector=expr("-x", vec2pt_9.Vector))
project = Project(Geometry=cluster_26, Plane=pln_3)  # -> Geometry, Transform
ln = Line(StartPoint=avr, EndPoint=project.Geometry)
vec2pt_10 = Vector2Pt(PointA=cluster_26, PointB=project.Geometry, Unitize=False)  # -> Vector, Length
vdis_7 = VectorDisplay(Anchor=project.Geometry, Vector=expr("-x", vec2pt_10.Vector))
vdis_8 = VectorDisplay(Anchor=cluster_26, Vector=vec2pt_10.Vector)

# ---- group: Preview Mechanism
scale = Slider(4, range=1..5)
line_width = Panel("2")
pt_24 = Point(pt_18)
vec_3 = Vector(cluster_9)

# ---- group: Preview Mechanism / Vector X,Y,Z components
vector_components = VectorComponents(pt=pt_24, vec=vec_3, num=scale)  # -> pt_4, vec_4

# ---- group: Preview Mechanism / Rescaled vector
cluster_29 = Cluster_16(pt=pt_24, vec=vec_3, scale=scale)  # -> pt_2, vec_2

# ---- group: Preview Mechanism (continued)
vdisex_4 = VectorDisplayEx(
    Point=cluster_29.pt_2,
    Vector=cluster_29.vec_2,
    Colour=ColourSwatch(SwatchColor=RGB(0, 0, 0)),
    Width=expr("x*3", line_width))
vdisex_5 = VectorDisplayEx(Point=vector_components.pt_4, Vector=vector_components.vec_4, Colour=RGB(0, 0, 0), Width=line_width)

# ==== cluster CreateStructure
C = ClusterInput()
A = ClusterInput()
N = ClusterInput()
pframes = PerpFrames(Curve=C, Count=N, Align=True)  # -> Frames, Parameters
rotate = Rotate(Geometry=pframes.Frames, Angle=A, Plane=pframes.Frames)  # -> Geometry, Transform
planes = ClusterOutput(rotate.Geometry)

# ==== cluster RotateBasePlanes
relay = ClusterInput()
angle_rad = ClusterInput()

# ---- group: nbr of planes
lng = ListLength(List=relay)

# ---- group: 0 Alterned angles
repeat = RepeatData(Data=flatten(["0", angle_rad]), Length=lng)  # -> flatten(Data)
plane_angles_rad = Panel(repeat)

# ----
_0_alterned_1_spiral = ClusterInput()

# ---- group: 1 Spiral angles
series = Series(Start=0, Step=angle_rad, Count=lng)  # -> flatten(Series)
plane_angles_rad_2 = Panel(series)

# ---- group: Chosen Angles
filter = StreamFilter(Gate=_0_alterned_1_spiral, Stream0=plane_angles_rad, Stream1=plane_angles_rad_2)

# ----
rotate = Rotate(Geometry=relay, Angle=filter, Plane=relay)  # -> Geometry, Transform
G = ClusterOutput(rotate.Geometry)

# ==== cluster Cluster
C = ClusterInput()
explode = Explode(Curve=C, Recursive=True)  # -> simplify(Segments), simplify(Vertices)
cset = CreateSet(List=explode.Vertices)  # -> Set, Map
S = ClusterOutput(explode.Segments)
S_2 = ClusterOutput(cset.Set)

# ==== cluster LongCables
T = ClusterInput()
viewer = ParamViewer(T)
points = PointList(Points=T, Size="0.5")
shift = ShiftList(List=viewer, Shift=-1, Wrap=False)
shift_2 = ShiftList(List=viewer, Shift=1, Wrap=False)
panel = Panel(shift_2)
panel_2 = Panel(shift)
branch = TreeBranch(Tree=T, Path=panel_2, MaintainPaths=True)
branch_2 = TreeBranch(Tree=T, Path=panel, MaintainPaths=True)
ln = Line(StartPoint=branch, EndPoint=branch_2)
L = ClusterOutput(ln)

# ==== cluster Cluster_2
nodes = ClusterInput()
planes = ClusterInput()
bool = ClusterInput()
deplane = DeconstructPlane(Plane=planes)  # -> Origin, XAxis, YAxis, ZAxis

# ---- group: nbr of points per plane
lng = ListLength(List=nodes)

# ---- group: Points on initial curve
pt = Point(simplify(graft(deplane.Origin)))

# ----
repeat = RepeatData(Data=pt, Length=lng)  # -> simplify(Data)

# ---- group: Additional transversal cables
ln = Line(StartPoint=nodes, EndPoint=repeat)

# ---- group: Draw add transv. cables ?
filter = StreamFilter(Gate=bool, Stream1=ln)  # -> simplify(Stream)

# ---- group: Draw add center points ?
filter_2 = StreamFilter(Gate=bool, Stream1=pt)  # -> simplify(Stream)

# ----
cables = ClusterOutput(filter)
points = ClusterOutput(filter_2)

# ==== cluster Cluster_3
alterned_spiral = ClusterInput()
nodes = ClusterInput()
gate = StreamGate(Stream=nodes, Gate=alterned_spiral)  # -> Target0, Target1
nbr_add_cables = ClusterInput()
points = PointList(Points=gate.Target0, Size="0.5")

# ---- group: Spiral
points_2 = PointList(Points=gate.Target1, Size="0.5")
viewer = ParamViewer(gate.Target1)
shift = ShiftList(List=viewer, Shift=-1, Wrap=False)
shift_2 = ShiftList(List=viewer, Shift=1, Wrap=False)
panel = Panel(shift_2)
panel_2 = Panel(shift)
panel_3 = Panel("-1")

# ---- group: Spiral / Top Points not shifted
branch = TreeBranch(Tree=gate.Target1, Path=panel, MaintainPaths=True)

# ---- group: Spiral / Top Points
shift_3 = ShiftList(List=branch, Shift=panel_3, Wrap=True)  # -> simplify(List)

# ---- group: Spiral / Bottom Points
branch_2 = TreeBranch(Tree=gate.Target1, Path=panel_2, MaintainPaths=True)

# ---- group: cables to draw
series = Series(Start=0, Step=1, Count=nbr_add_cables)

# ---- group: Alterned
# Description: The nodes index of one branch over two must be shifted due to alterned configuration
viewer_2 = ParamViewer(gate.Target0)
panel_4 = Panel("""True
False""")
panel_5 = Panel("""False
True""")
cull = CullPattern(List=viewer_2, CullPattern=panel_4)
cull_2 = CullPattern(List=viewer_2, CullPattern=panel_5)
panel_6 = Panel(cull)
panel_7 = Panel(cull_2)
branch_3 = TreeBranch(Tree=gate.Target0, Path=panel_7, MaintainPaths=True)
panel_8 = Panel("-1")

# ---- group: Alterned / Regular Branch
branch_4 = TreeBranch(Tree=gate.Target0, Path=panel_6, MaintainPaths=True)

# ---- group: Alterned / Alterned Branch
bot = ShiftList(List=branch_3, Shift=panel_8, Wrap=True)  # -> simplify(List)

# ---- group: Alterned / Nodes tree with alterned branch
merge = Merge(Data1=branch_4, Data2=bot)  # -> simplify(Result)

# ---- group: Alterned (continued)
viewer_3 = ParamViewer(merge)
shift_4 = ShiftList(List=viewer_3, Shift=-1, Wrap=False)
shift_5 = ShiftList(List=viewer_3, Shift=1, Wrap=False)
panel_9 = Panel(shift_5)
panel_10 = Panel(shift_4)

# ----
points_3 = PointList(Points=merge, Size="0.5")

# ---- group: Alterned / Bottom Points
branch_5 = TreeBranch(Tree=merge, Path=panel_10, MaintainPaths=True)

# ---- group: Alterned / Top Points
branch_6 = TreeBranch(Tree=merge, Path=panel_9, MaintainPaths=True)

# ---- group: Bottom Points - Alterned or Spiral ?
filter = StreamFilter(Gate=alterned_spiral, Stream0=branch_5, Stream1=branch_2)

# ---- group: Top Points - Alterned or Spiral ?
filter_2 = StreamFilter(Gate=alterned_spiral, Stream0=branch_6, Stream1=shift_3)

# ---- group: Bottom points to draw
selection_of_start_points = ListItem(List=filter, Index=series, Wrap=True)

# ---- group: Top Points to draw
item = ListItem(List=filter_2, Index=series, Wrap=True)

# ---- group: Additional long cables
ln = Line(StartPoint=selection_of_start_points, EndPoint=item)

# ----
L = ClusterOutput(ln)

# ==== cluster Cluster_4
nodes = ClusterInput()
alterned_spiral = ClusterInput()
viewer = ParamViewer(nodes)
points = PointList(Points=nodes, Size="0.5")
panel = Panel("""1
-1""")
shift = ShiftList(List=viewer, Shift=-1, Wrap=False)
shift_2 = ShiftList(List=viewer, Shift=1, Wrap=False)
lng = ListLength(List=shift_2)
repeat = RepeatData(Data=panel, Length=lng)  # -> simplify(graft(Data))
panel_2 = Panel(shift_2)
panel_3 = Panel(shift)
panel_4 = Panel(repeat)

# ---- group: Alterned or Spiral ?
filter = StreamFilter(Gate=alterned_spiral, Stream0=panel_4, Stream1="1")

# ---- group: Bottom points
branch = TreeBranch(Tree=nodes, Path=panel_3, MaintainPaths=True)

# ---- group: Top Points
branch_2 = TreeBranch(Tree=nodes, Path=panel_2, MaintainPaths=True)

# ---- group: Top Points Shifted
shift_3 = ShiftList(List=branch_2, Shift=filter, Wrap=True)  # -> simplify(List)

# ----
points_2 = PointList(Points=branch, Size="0.5")
points_3 = PointList(Points=shift_3, Size="0.5")
ln = Line(StartPoint=branch, EndPoint=shift_3)
L = ClusterOutput(ln)

# ==== cluster Cluster_5
P = ClusterInput()
A = ClusterInput()
B = ClusterInput()
pdecon = Deconstruct(Point=P)  # -> XComponent, YComponent, ZComponent
B_2 = ClusterInput()
N = ClusterInput()
multiplication = Multiplication(A=A, B=B)
dom = ConstructDomain(DomainStart=pdecon.ZComponent, DomainEnd=B_2)
range = Range(Domain=dom, Steps=N)
addition = Addition(A=pdecon.XComponent, B=multiplication)
panel = Panel(multiplication)
pt = ConstructPoint(XCoordinate=addition, YCoordinate=pdecon.YComponent, ZCoordinate=range)
pline = PolyLine(Vertices=pt, Closed=False)
pl = ClusterOutput(pline)

# ==== cluster Cluster_6
pt = ClusterInput()
pt_2 = Point(pt)
item = ListItem(List=pt_2, Index="0", Wrap=True)
item_2 = ListItem(List=pt_2, Index="1", Wrap=True)
item_3 = ListItem(List=pt_2, Index="2", Wrap=True)
merge = Merge(Data1=item_3, Data2=item_2, Data3=item)
pt_3 = Point(flatten(merge))
pt_4 = ClusterOutput(pt_3)

# ==== cluster Cluster_7
pt = ClusterInput()

# ---- group: All Nodes
pt_2 = Point(pt)

# ----
panel = Panel("""3
4
5""")
panel_2 = Panel("""0
1
2""")
item = ListItem(List=pt_2, Index=panel, Wrap=True)
item_2 = ListItem(List=pt_2, Index=panel_2, Wrap=True)

# ---- group: Bottom Nodes
pt_3 = Point(flatten(item_2))

# ---- group: Top Nodes
pt_4 = Point(item)

# ----
bang = ExplodeTree(Data=graft(pt_3))  # -> Branch0, Branch1, Branch2
pl_3pt = Plane3Pt(PointA=bang.Branch1, PointB=bang.Branch0, PointC=bang.Branch2)
pln = Plane(pl_3pt)
avr = Average(Input=pt_3)
project = Project(Geometry=pt_4, Plane=pln)  # -> Geometry, Transform
am = ClusterOutput(avr)
G = ClusterOutput(project.Geometry)
bottom_nodes = ClusterOutput(pt_3)

# ==== cluster Cluster_8
L = ClusterInput()
panel = Panel("""3
4
5""")
item = ListItem(List=L, Index=panel, Wrap=True)
pt = Point(item)
top_points = ClusterOutput(pt)

# ==== cluster Cluster_9
F = ClusterInput()
B = ClusterInput()
Z = UnitZ(Factor=F)
addition = Addition(A=Z, B=B)
R = ClusterOutput(addition)

# ==== cluster Cluster_10
L = ClusterInput()
L_2 = ClusterInput()
L_3 = ClusterInput()
L_4 = ClusterInput()
L_5 = ClusterInput()
L_6 = ClusterInput()
num = ClusterInput()
item = ListItem(List=L, Index="2", Wrap=True)
item_2 = ListItem(List=L_2, Index="2", Wrap=True)
item_3 = ListItem(List=L_3, Index="1", Wrap=True)
item_4 = ListItem(List=L_4, Index="1", Wrap=True)
item_5 = ListItem(List=L_5, Index="0", Wrap=True)
item_6 = ListItem(List=L_6, Index="0", Wrap=True)
num_2 = Number(num)
tag = TextTag3D(Location=item, Text=item_2, Size=num_2, Justification=6)
tag_2 = TextTag3D(Location=item_3, Text=item_4, Size=num_2, Justification=9)
tag_3 = TextTag3D(Location=item_5, Text=item_6, Size=num_2, Justification=3)

# ==== cluster Cluster_11
A = ClusterInput()
B = ClusterInput()
B_2 = ClusterInput()
vec2pt = Vector2Pt(PointA=A, PointB=B, Unitize=False)  # -> Vector, Length
A_2 = ClusterInput()
multiplication = Multiplication(A=vec2pt.Vector, B=B_2)
addition = Addition(A=A_2, B=multiplication)
R = ClusterOutput(addition)

# ==== cluster Cluster_12
pt = ClusterInput()
pt_2 = Point(pt)
F = ClusterInput()
Z = UnitZ(Factor=F)
R = ClusterInput()
eval = Evaluate(F="Format(\"{0:0.0} {1:0.0} {2:0.0}\", x.x*1000, x.y*1000, x.z*1000)", x=pt_2)
addition = Addition(A=pt_2, B=Z)
sph = Sphere(Base=pt_2, Radius=R)
r = ClusterOutput(eval)
R_2 = ClusterOutput(addition)
S = ClusterOutput(sph)
swatch = ClusterOutput(ColourSwatch(SwatchColor=RGB(0, 0, 0)))

# ==== cluster SelectMode
I = ClusterInput()
T = ClusterInput()
path = ConstructPath(Indices=I)
branch = TreeBranch(Tree=T, Path=path, MaintainPaths=True)
B = ClusterOutput(branch)

# ==== cluster Cluster_13
struct = ClusterInput()
destruct = DeconstructStructure(Structure=struct)  # -> Nodes, Elements
deelem = DeconstructElement(Element=destruct.Elements)  # -> Name, ElementIndex, EndNodesIndexes, Line, FreeLength, CrossSection, Material, Weight, Tension, TminTmaxKN
L = ClusterOutput(deelem.Line)

# ==== cluster Cluster_14
num = ClusterInput()
num_2 = Number(num)
bnd = Bounds(Numbers=num_2)
multiplication = Multiplication(A=num_2, B=-1)
dedomain = DeconstructDomain(Domain=bnd)  # -> Start, End
division = Division(A=multiplication, B=dedomain.End)
R = ClusterOutput(division)

# ==== cluster Cluster_15
vec = ClusterInput()
vec_2 = Vector(vec)
devec = DeconstructVector(Vector=vec_2)  # -> XComponent, YComponent, ZComponent
bnd = Bounds(Numbers=devec.ZComponent)
dedomain = DeconstructDomain(Domain=bnd)  # -> Start, End
multiplication = Multiplication(A=dedomain.End, B=-1)
division = Division(A=vec_2, B=multiplication)
vec_3 = Vector(division)
vec_4 = ClusterOutput(vec_3)

# ==== cluster VectorComponents
pt = ClusterInput()
vec = ClusterInput()
num = ClusterInput()
vec_2 = Vector(vec)
num_2 = Number(num)
pt_2 = Point(pt)
devec = DeconstructVector(Vector=vec_2)  # -> XComponent, YComponent, ZComponent
Y = UnitY(Factor=devec.YComponent)
Z = UnitZ(Factor=devec.ZComponent)
X = UnitX(Factor=devec.XComponent)
division = Division(A=X, B=num_2)
division_2 = Division(A=Y, B=num_2)
division_3 = Division(A=Z, B=num_2)
entwine = Entwine(Branch00=pt_2, Branch01=pt_2, Branch02=pt_2, FlattenInputs=True)
entwine_2 = Entwine(Branch00=division, Branch01=division_2, Branch02=division_3, FlattenInputs=True)
pt_3 = Point(entwine)
pt_4 = ClusterOutput(pt_3)
vec_3 = Vector(entwine_2)
vec_4 = ClusterOutput(vec_3)

# ==== cluster Cluster_16
vec = ClusterInput()
scale = ClusterInput()
pt = ClusterInput()
pt_2 = ClusterOutput(pt)
division = Division(Vec=vec, Scale=scale)
vec_2 = ClusterOutput(division)
